# Grasshopper definition autonest_v2.gh (Grasshopper 1.0.8)
# plug-ins: opennest_2 Info

cut = Curve([<curve referenced from the Rhino model> x12])
from = Slider(1, range=0..1000)
count = Slider(50, range=1..500)
minutes = Slider(0, range=0..120)
curve = Curve(<curve referenced from the Rhino model>)
run = BooleanToggle(True)
tol_cm = Panel("1")
bake = Button()
graft = GraftTree(Tree=cut, IncludeEmptyLists=True, IncludeNullItems=True)
curve_2 = Curve(flatten(graft))
opennest1 = OpenNest1(
    Sheets=curve,
    Geo=curve_2,
    Spacing="0",
    Placement=Slider(3, range=0..3),
    Tolerance=0.1,
    Rotations=Slider(4, range=1..4),
    Iterations=Slider(310, range=0..1000),
    Seed=Slider(29, range=1..100),
    Reset=Button(),
    Run=Toggle(True))  # -> Sheets, Geo, ID, Transform, IDS
seedsearch = GhPythonScript(Geo=opennest1.Geo, Run=run, From=from, Count=count, Minutes=minutes, Tol=tol_cm)  # -> out, Seed, L, A, Table; inputs Geo: tree
# ---------- seedsearch: Python ----------
# -*- coding: utf-8 -*-
"""SeedSearch — GhPython component for autonest_v2.gh.

Tries OpenNest2 seeds one after another and keeps the layout that takes the
least material along X; among the shortest (within Tol) — the smallest
bounding box area. OpenNest2 runs its generations over many solutions, so
Galapagos can't score it; this component waits for each result ("fit …").

Inputs:
    Geo     : Geo output of OpenNest (only to be solved when it changes;
              the layout is read from OpenNest itself)
    Run     : Boolean Toggle — True starts a new search, False stops it
    From    : first seed (default 1)
    Count   : how many seeds (default 50)
    Minutes : time limit, 0 — none
    Tol     : cm — lengths within Tol count as equally short (default 1)
Outputs:
    Seed    : best seed (set on the Seed slider at the end)
    L       : its length along X, cm
    A       : its bounding box area, m²
    Table   : "seed  L cm  A m²" per tried seed, best first
"""


def pick(results, tol):
    """(seed, length, area) list → best one: shortest within tol, then least area."""
    if not results:
        return None
    short = min(r[1] for r in results)
    return min((r for r in results if r[1] <= short + tol), key=lambda r: (r[2], r[1]))


def table(results, tol):
    best = pick(results, tol)
    rows = sorted(results, key=lambda r: (r[1], r[2]))
    rows.remove(best)
    return ["%d  %.1f cm  %.3f m2" % r for r in [best] + rows]


if "ghenv" in globals():
    import time
    import System
    import Rhino
    import scriptcontext as sc
    import Grasshopper

    comp = ghenv.Component
    gd = comp.OnPingDocument()
    key = "SeedSearch_%s" % comp.InstanceGuid
    st = sc.sticky.get(key)

    From = int(From) if From is not None else 1
    Count = int(Count) if Count else 50
    Minutes = float(Minutes) if Minutes else 0.0
    Tol = float(Tol) if Tol is not None else 1.0
    cm = Rhino.RhinoMath.UnitScale(Rhino.RhinoDoc.ActiveDoc.ModelUnitSystem, Rhino.UnitSystem.Centimeters)

    nest = None
    for s in comp.Params.Input[0].Sources:
        o = s.Attributes.GetTopLevel.DocObject
        if o.GetType().FullName.endswith("component_nest1"):
            nest = o
    if nest is None:
        comp.AddRuntimeMessage(Grasshopper.Kernel.GH_RuntimeMessageLevel.Error, "Geo must come from OpenNest")
    else:
        inp = dict((p.Name, p) for p in nest.Params.Input)
        slider = inp["Seed"].Sources[0] if inp["Seed"].Sources else None
        if not isinstance(slider, Grasshopper.Kernel.Special.GH_NumberSlider):
            comp.AddRuntimeMessage(Grasshopper.Kernel.GH_RuntimeMessageLevel.Error, "OpenNest Seed needs a Number Slider")
            slider = None

        def measure():
            """(length, area) of the finished layout in cm / m², None while OpenNest is busy."""
            if not (nest.Message or "").startswith("fit"):
                return None
            box = Rhino.Geometry.BoundingBox.Empty
            for g in nest.Params.Output[1].VolatileData.AllData(True):
                box.Union(g.Boundingbox)
            if not box.IsValid:
                return None
            x0 = min(g.Boundingbox.Min.X for g in inp["Sheets"].VolatileData.AllData(True))
            length = (box.Max.X - x0) * cm
            return length, length * (box.Max.Y - box.Min.Y) * cm / 1e4

        def set_seed(value):
            st["asked"] = value
            def cb(doc):
                v = System.Decimal(value)
                if v > slider.Slider.Maximum:
                    slider.Slider.Maximum = v
                if v < slider.Slider.Minimum:
                    slider.Slider.Minimum = v
                slider.SetSliderValue(v)
                slider.ExpireSolution(False)
            gd.ScheduleSolution(5, Grasshopper.Kernel.GH_Document.GH_ScheduleDelegate(cb))

        was_on = sc.sticky.get(key + "_run", False)
        sc.sticky[key + "_run"] = bool(Run)
        if Run and slider and not was_on:
            st = sc.sticky[key] = {"run": True, "seeds": list(range(From, From + Count)),
                                   "results": [], "t0": time.time(), "busy": False, "asked": None}
        elif not Run and was_on and st and st["run"]:
            st["run"] = False
            if st["results"]:
                set_seed(pick(st["results"], Tol)[0])

        if st and st["run"]:
            seed = st["seeds"][0]
            done = measure()
            if int(slider.CurrentValue) != seed:
                st["busy"] = False
                if st.get("asked") != seed:
                    set_seed(seed)
            elif done is None:
                st["busy"] = True
            elif st["busy"] or not st["results"]:
                # ponytail: no per-seed timeout — if OpenNest never prints "fit" the search waits; Run off stops it
                st["results"].append((seed, done[0], done[1]))
                st["seeds"].pop(0)
                st["busy"] = False
                late = Minutes and time.time() - st["t0"] > Minutes * 60
                if st["seeds"] and not late:
                    set_seed(st["seeds"][0])
                else:
                    st["run"] = False
                    set_seed(pick(st["results"], Tol)[0])

        if st and st["results"]:
            best = pick(st["results"], Tol)
            Seed, L, A = best
            Table = table(st["results"], Tol)
            comp.Message = "%s %d/%d  best %d" % ("seed" if st["run"] else "done", len(st["results"]),
                                                  len(st["results"]) + len(st["seeds"]), best[0])
        else:
            comp.Message = "seed %d…" % st["seeds"][0] if st and st["run"] else "Run = True"


if __name__ == "__main__" and "ghenv" not in globals():
    r = [(1, 1500.0, 30.0), (2, 1439.2, 29.8), (3, 1439.9, 28.0), (4, 1441.0, 20.0)]
    assert pick(r, 1.0)[0] == 3       # 1439.9 within 1 cm of the shortest, smaller area
    assert pick(r, 0.5)[0] == 2       # only the shortest
    assert pick(r, 2.0)[0] == 4
    assert pick([], 1.0) is None
    assert table(r, 1.0)[0].startswith("3 ")
    print("ok")
# ---------- end seedsearch ----------
curve_3 = Curve(flatten(opennest1.Geo))
seeds = Panel(seedsearch.Table)
carryinside = GhPythonScript(Cut=cut, X=opennest1.Transform, Bake=bake)  # -> out, CUT, INK, INT, Other, N; inputs Cut: tree, X: tree
# ---------- carryinside: Python ----------
# -*- coding: utf-8 -*-
"""CarryInside — GhPython component for autonest_v2.gh.

Everything that lies inside each Cut (INK, INT, texts, points, holes — any
visible object of the Rhino document, any layer) goes with the Cut to its
nested place: the Cut's own OpenNest transform is applied to a copy.

An object belongs to a Cut when its start, middle or end (point / text:
its centre) is inside the Cut or on its line; inside several Cuts — the
smallest one. Objects inside no Cut stay where they are.

Inputs:
    Cut  : the Cut curves referenced from Rhino — the same list OpenNest
           nests (Tree access)
    X    : Transform output of OpenNest (Tree access)
    Bake : Button — copies (Cut + everything inside) added to the Rhino
           document with their own layer / colour / linetype, one group per
           part, one undo
Outputs (one per layer, to bake each into its layer; branch {i} = Cut i):
    CUT   : moved Cut copies
    INK   : moved copies from layer INK
    INT   : moved copies from layer INT
    Other : moved copies from any other layer
    N     : "<cut>: <objects inside>" per Cut
"""


def owner(hits, areas):
    """Index of the Cut an object belongs to: the smallest Cut holding one of its points."""
    return min(hits, key=lambda i: areas[i]) if hits else None


if "ghenv" in globals():
    import Rhino
    import Rhino.Geometry as rg
    import Grasshopper
    from Grasshopper import DataTree
    from Grasshopper.Kernel.Data import GH_Path

    LAYERS = ["CUT", "INK", "INT"]
    comp = ghenv.Component
    rdoc = Rhino.RhinoDoc.ActiveDoc
    tol = rdoc.ModelAbsoluteTolerance
    ids = [g.ReferenceID for g in comp.Params.Input[0].VolatileData.AllData(True)]
    cuts = [rdoc.Objects.FindId(i) for i in ids]
    xdata = comp.Params.Input[1].VolatileData
    xforms = [[g.Value for g in xdata.Branches[i]] if i < xdata.PathCount else [] for i in range(len(ids))]

    if not ids or None in cuts:
        comp.AddRuntimeMessage(Grasshopper.Kernel.GH_RuntimeMessageLevel.Error, "Cut must be curves referenced from Rhino")
    elif any(xforms):
        curves = [c.Geometry for c in cuts]
        boxes = [c.GetBoundingBox(True) for c in curves]
        for b in boxes:
            b.Inflate(tol)
        areas = []
        for c, b in zip(curves, boxes):
            mp = rg.AreaMassProperties.Compute(c) if c.IsClosed else None
            areas.append(mp.Area if mp else b.Area)

        def samples(geo):
            if isinstance(geo, rg.Curve):
                t = geo.NormalizedLengthParameter(0.5)[1]
                return [geo.PointAtStart, geo.PointAt(t), geo.PointAtEnd]
            if isinstance(geo, rg.Point):
                return [geo.Location]
            return [geo.GetBoundingBox(True).Center]

        inside = [[] for _ in ids]
        skip = set(ids)
        settings = Rhino.DocObjects.ObjectEnumeratorSettings()
        settings.HiddenObjects = False
        settings.LockedObjects = True
        settings.VisibleFilter = True
        for obj in rdoc.Objects.GetObjectList(settings):
            if obj.Id in skip or obj.Attributes.Space != Rhino.DocObjects.ActiveSpace.ModelSpace:
                continue
            hits = set()
            for p in samples(obj.Geometry):
                for i, (c, b) in enumerate(zip(curves, boxes)):
                    if b.Contains(p) and c.Contains(p, rg.Plane.WorldXY, tol) != rg.PointContainment.Outside:
                        hits.add(i)
            i = owner(hits, areas)
            if i is not None:
                inside[i].append(obj)

        out = dict((k, DataTree[object]()) for k in LAYERS + ["Other"])
        N = []
        parts = []
        for i, cut in enumerate(cuts):
            N.append("%d: %d" % (i, len(inside[i])))
            if len(xforms[i]) != 1:
                comp.AddRuntimeMessage(Grasshopper.Kernel.GH_RuntimeMessageLevel.Warning, "Cut %d not placed — left out" % i)
                continue
            part = []
            for obj in [cut] + inside[i]:
                g = obj.Geometry.Duplicate()
                g.Transform(xforms[i][0])
                top = rdoc.Layers[obj.Attributes.LayerIndex].FullPath.split("::")[0].upper()
                out[top if top in LAYERS else "Other"].Add(g, GH_Path(i))
                part.append((g, obj.Attributes))
            parts.append(part)

        if Bake:
            rec = rdoc.BeginUndoRecord("CarryInside bake")
            for part in parts:
                group = rdoc.Groups.Add()
                for g, attrs in part:
                    a = attrs.Duplicate()
                    a.RemoveFromAllGroups()
                    a.AddToGroup(group)
                    rdoc.Objects.Add(g, a)
            rdoc.EndUndoRecord(rec)
            rdoc.Views.Redraw()
        CUT, INK, INT, Other = [out[k] for k in LAYERS + ["Other"]]
        comp.Message = "%d parts, %d inside" % (len(parts), sum(len(p) - 1 for p in parts))


if __name__ == "__main__" and "ghenv" not in globals():
    assert owner(set(), [1.0]) is None
    assert owner({0, 2}, [5.0, 1.0, 2.0]) == 2      # nested: the smaller Cut wins
    assert owner({1}, [5.0, 1.0]) == 1
    print("ok")
# ---------- end carryinside ----------
geometry = Geometry(curve_3)
